# Dynamo graph filled_regions_from_rooms.dyn (Dynamo 2.3.1.11775)

views = Views("000_Power BI")
categories = Categories("OST_Rooms")
all_elements_of_category = ElementsOfCategory(Category=categories)
string = StringInput("Level")
getParameterValueByName = Element.GetParameterValueByName(element=all_elements_of_category, parameterName=string)
levels = Levels("B100_02")
name = Level.Name(level=levels)
eq = getParameterValueByName == name
filterByBoolMask = List.FilterByBoolMask(list=all_elements_of_category, mask=eq)
finishBoundary = Room.FinishBoundary(room=filterByBoolMask.in)
select_filled_region_type = FilledRegionTypes("Power BI")

# group: Output
byCurves = FilledRegion.ByCurves(view=views, boundary=finishBoundary, regionType=select_filled_region_type)
