# Dynamo graph delete_unused_view_filters.dyn (Dynamo 2.3.1.11775)

# group: Views retrieve
code_block = CodeBlock { "Views"; }
byName = Category.ByName(name=code_block)
all_elements_of_category = ElementsOfCategory(Category=byName)

code_block_2 = CodeBlock { false; }
clean = List.Clean(list=all_elements_of_category, preserveIndices=code_block_2)
filters = View.Filters(view=clean)
flatten = List.Flatten(list=filters)
uniqueItems = List.UniqueItems(list=flatten)

# group: View filters in use
name = Element.Name(element=uniqueItems)
watch = Watch(name)

# group: Obtain all filters
element_types = ElementTypes("FilterElement")
all_elements_of_type = ElementsOfType(element_type=element_types)

# group: All filters in project
name_2 = Element.Name(element=all_elements_of_type)
watch_2 = Watch(name_2)

indexOf = List.IndexOf(list=all_elements_of_type, element=uniqueItems)
removeItemAtIndex = List.RemoveItemAtIndex(list=all_elements_of_type, indices=indexOf)

# group: View filters not in use
name_3 = Element.Name(element=removeItemAtIndex)
watch_3 = Watch(name_3)

# group: Final action
delete = Element.Delete(element=removeItemAtIndex)
