# Dynamo graph outsmarting_revit_view_filters.dyn (Dynamo 2.3.1.11775)

categories = Categories("OST_Walls")
all_elements_of_category = ElementsOfCategory(Category=categories)
code_block = CodeBlock { "Comments"; }
code_block_2 = CodeBlock { "Phase Created"; }
getParameterValueByName = Element.GetParameterValueByName(element=all_elements_of_category, parameterName=code_block_2)
name = Element.Name(element=getParameterValueByName)
# note: Useful to fill blank spaces in schedules
string = StringInput("(none)")
isNull = Object.IsNull()  # unwired: obj
replaceByCondition = Replace(item=name, replaceWith=string, condition=isNull)
setParameterByName = Element.SetParameterByName(element=all_elements_of_category, parameterName=code_block, value=replaceByCondition)
