# Dynamo graph reset_graphics.dyn (Dynamo 2.3.1.11775)
# packages: Clockwork for Dynamo 2.x 2.3.0

all_elements_in_active_view = ElementsInView()
current = Document.Current()
activeView = Document.ActiveView(document=current)
resetElementOverrides = Custom[View.ResetElementOverrides](element=all_elements_in_active_view, view=activeView)  # package Clockwork for Dynamo 2.x; Resets all overrides for an element in a given view
